# Grasshopper definition 20171124_roadChamfer.gh (Grasshopper 0.9.76)

# ---- group: getDirectionIndex()
roadpoints = Point([Point(56, -51, 0), Point(56, -20, 0), Point(88, -20, 0)])
const_txt = Text(["1,1", "1,-1", "-1,-1", "-1,1"])
item = ListItem(List=roadpoints, Index="1", Wrap=True)  # -> Item1, Item, Item1_2
subtraction = Subtraction(A=[item.Item1, item.Item1_2], B=item.Item)
unit = UnitVector(Vector=subtraction)
complex = ComplexComponents(Complex=unit)  # -> Real, Imaginary
panel = Panel("""0
2
1
3""")
equals = Equality(FirstNumber=complex.Real, SecondNumber=0)  # -> Equality, Inequality
merge = Merge(Data1=complex.Real, Data2=complex.Imaginary)
partition = PartitionList(List=panel, Size=[2, 2])
partition_2 = PartitionList(List=merge, Size=[2, 2])
item_2 = ListItem(List=partition, Index=graft(equals.Equality), Wrap=True)
flip = FlipMatrix(Data=partition_2)  # -> flatten(Data)
item_3 = ListItem(List=flip, Index=item_2, Wrap=True)  # -> flatten(Item)
int = Integer(item_3)
join = TextJoin(Text=int, Join=",")
mindex = MemberIndex(Set=const_txt, Member=join)  # -> Index, Count
directionindex = Integer(mindex.Index)

# ---- group: getOriginalPlane()
directionindex_2 = Integer(1)
intersection = Point(Point(56, -20, 0))
const_vec = Vector([Vector(1, 1, 0), Vector(1, -1, 0), Vector(-1, -1, 0), Vector(-1, 1, 0)])
radius = Number(10)
sqrt = SquareRoot(Value=2)
item_4 = ListItem(List=const_vec, Index=directionindex_2, Wrap=True)
multiplication = Multiplication(A=radius, B=sqrt)
amp = Amplitude(Vector=item_4, Amplitude=multiplication)
neg = Negative(Value=item_4)
addition = Addition(A=intersection, B=amp)
complex_2 = ComplexComponents(Complex=neg)  # -> Real, Imaginary
pt = Point(addition)
merge_2 = Merge(Data1=complex_2.Real, Data2=complex_2.Imaginary)
pl = ConstructPlane(Origin=pt, XAxis=Vector(1, 0, 0), YAxis=Vector(0, 1, 0))
directionsignal = Integer(merge_2)
originalplane = Plane(pl)

# ---- group: getChamferPoints()
directionsignal_2 = Integer([-1, -1])
originalplane_2 = Plane(PlaneXY(56, -5, 0))
segment = Integer(3)
radius_2 = Number(10)
addition_2 = Addition(A=segment, B=1)
division = Division(A=1.570796327, B=segment)
series = Series(Start=0, Step=division, Count=addition_2)
sin = Sine(Value=series)
multiplication_2 = Multiplication(A=sin, B=radius_2)
rev = ReverseList(List=multiplication_2)
merge_3 = Merge(Data1=multiplication_2, Data2=rev)
stack = StackData(Data=addition_2, Stack=2)
partition_3 = PartitionList(List=merge_3, Size=stack)
multiplication_3 = Multiplication(A=graft(directionsignal_2), B=partition_3)  # -> simplify(Result)
bang = ExplodeTree(Data=multiplication_3)  # -> Branch0, Branch1
pt_2 = PointOriented(BasePlane=originalplane_2, UComponent=bang.Branch0, VComponent=bang.Branch1, WComponent=0)
chamferpoints = Point(pt_2)

# ---- group: points_to_curve()
chamferpoints_2 = Point([Point(56, -15, 0), Point(51, -13.66025404, 0), Point(47.33974596, -10, 0), Point(46, -5, 0)])
roadpoints_2 = Point([Point(46, 12, 0), Point(46, -15, 0), Point(78, -15, 0)])
item_5 = ListItem(List=roadpoints_2, Index="1", Wrap=True)  # -> Item1, Item, Item1_2
merge_4 = Merge(Data1=item_5.Item1_2, Data2=chamferpoints_2, Data3=item_5.Item1)
pline = PolyLine(Vertices=chamferpoints_2, Closed=False)
pline_2 = PolyLine(Vertices=merge_4, Closed=False)
roadcurve_chamferred = Curve(pline_2)
chamfercurve = Curve(pline)

# ----
pline_3 = PolyLine(Vertices=[Point(35, 10, 0), Point(35, -10, 0), Point(15, -10, 0)], Closed=False)
pline_4 = PolyLine(Vertices=[Point(56, -51, 0), Point(56, -20, 0), Point(88, -20, 0)], Closed=False)
pline_5 = PolyLine(Vertices=[Point(46, 12, 0), Point(46, -15, 0), Point(78, -15, 0)], Closed=False)
pline_6 = PolyLine(Vertices=[Point(33, -55, 0), Point(33, -25, 0), Point(6, -25, 0)], Closed=False)
explode = Explode(Curve=pline_5, Recursive=True)  # -> Segments, Vertices
panel_2 = Panel("""1,1
1,-1
-1,-1
-1,1""")
roadpoints_3 = Point(explode.Vertices)
const_txt_2 = Text(panel_2)
segment_2 = Integer(Slider(3, range=0..10))
radius_3 = Number(Slider(10, range=0..10))

# ---- group: getDirectionIndex()
roadpoints_4 = Point(roadpoints_3)
item_6 = ListItem(List=roadpoints_4, Index="1", Wrap=True)  # -> Item1, Item, Item1_2
subtraction_2 = Subtraction(A=[item_6.Item1, item_6.Item1_2], B=item_6.Item)
unit_2 = UnitVector(Vector=subtraction_2)
complex_3 = ComplexComponents(Complex=unit_2)  # -> Real, Imaginary
panel_3 = Panel("""0
2
1
3""")
equals_2 = Equality(FirstNumber=complex_3.Real, SecondNumber=0)  # -> Equality, Inequality
merge_5 = Merge(Data1=complex_3.Real, Data2=complex_3.Imaginary)
partition_4 = PartitionList(List=panel_3, Size=[2, 2])
partition_5 = PartitionList(List=merge_5, Size=[2, 2])
item_7 = ListItem(List=partition_4, Index=graft(equals_2.Equality), Wrap=True)
flip_2 = FlipMatrix(Data=partition_5)  # -> flatten(Data)
item_8 = ListItem(List=flip_2, Index=item_7, Wrap=True)  # -> flatten(Item)
int_2 = Integer(item_8)
join_2 = TextJoin(Text=int_2, Join=",")
mindex_2 = MemberIndex(Set=const_txt_2, Member=join_2)  # -> Index, Count
directionindex_3 = Integer(mindex_2.Index)

# ---- group: getOriginalPlane()
intersection_2 = Point(item_6.Item)
const_vec_2 = Vector(const_txt_2)
directionindex_4 = Integer(directionindex_3)
sqrt_2 = SquareRoot(Value=2)
item_9 = ListItem(List=const_vec_2, Index=directionindex_4, Wrap=True)
neg_2 = Negative(Value=item_9)
complex_4 = ComplexComponents(Complex=neg_2)  # -> Real, Imaginary
merge_6 = Merge(Data1=complex_4.Real, Data2=complex_4.Imaginary)
directionsignal_3 = Integer(merge_6)

# ---- group: getChamferPoints()
segment_3 = Integer(segment_2)
radius_4 = Number(radius_3)
addition_3 = Addition(A=segment_3, B=1)
division_2 = Division(A=1.570796327, B=segment_3)
series_2 = Series(Start=0, Step=division_2, Count=addition_3)
sin_2 = Sine(Value=series_2)
multiplication_4 = Multiplication(A=sin_2, B=radius_4)
rev_2 = ReverseList(List=multiplication_4)
merge_7 = Merge(Data1=multiplication_4, Data2=rev_2)
directionsignal_4 = Integer(directionsignal_3)
stack_2 = StackData(Data=addition_3, Stack=2)
partition_6 = PartitionList(List=merge_7, Size=stack_2)
multiplication_5 = Multiplication(A=graft(directionsignal_4), B=partition_6)  # -> simplify(Result)
bang_2 = ExplodeTree(Data=multiplication_5)  # -> Branch0, Branch1

# ---- group: getOriginalPlane() (continued)
radius_5 = Number(radius_4)
multiplication_6 = Multiplication(A=radius_5, B=sqrt_2)
amp_2 = Amplitude(Vector=item_9, Amplitude=multiplication_6)
addition_4 = Addition(A=intersection_2, B=amp_2)
pt_3 = Point(addition_4)
pl_2 = ConstructPlane(Origin=pt_3, XAxis=Vector(1, 0, 0), YAxis=Vector(0, 1, 0))
originalplane_3 = Plane(pl_2)

# ---- group: getChamferPoints() (continued)
originalplane_4 = Plane(originalplane_3)
pt_4 = PointOriented(BasePlane=originalplane_4, UComponent=bang_2.Branch0, VComponent=bang_2.Branch1, WComponent=0)
chamferpoints_3 = Point(pt_4)

# ---- group: points_to_curve()
chamferpoints_4 = Point(pt_4)
roadpoints_5 = Point(roadpoints_3)
item_10 = ListItem(List=roadpoints_5, Index="1", Wrap=True)  # -> Item1, Item, Item1_2
merge_8 = Merge(Data1=item_10.Item1_2, Data2=chamferpoints_4, Data3=item_10.Item1)
pline_7 = PolyLine(Vertices=chamferpoints_4, Closed=False)
pline_8 = PolyLine(Vertices=merge_8, Closed=False)
roadcurve_chamferred_2 = Curve(pline_8)
chamfercurve_2 = Curve(pline_7)
