# Grasshopper definition 20171124_mituh_roadChamfer.gh (Grasshopper 0.9.76)

list = ValueList({"Zero": 0, "One": 1, "Two": 2, "Three": 2² - 1}, selected="One")
int = Integer(list)
segment = Integer(Slider(5, range=0..10))
radius = Number(Slider(10, range=0..10))
addition = Addition(A=segment, B=1)
division = Division(A=1.570796327, B=segment)
panel = Panel("""1,1
1,-1
-1,-1
-1,1""")
series = Series(Start=0, Step=division, Count=addition)
sin = Sine(Value=series)
multiplication = Multiplication(A=sin, B=radius)
rev = ReverseList(List=multiplication)
txt = Text(panel)
item = ListItem(List=txt, Index=int, Wrap=True)
merge = Merge(Data1=multiplication, Data2=rev)
stack = StackData(Data=addition, Stack=2)
split = TextSplit(Text=item, Separators=",")
partition = PartitionList(List=merge, Size=stack)
multiplication_2 = Multiplication(A=graft(split), B=partition)  # -> simplify(Result)
bang = ExplodeTree(Data=multiplication_2)  # -> Branch0, Branch1
pt = PointOriented(BasePlane=PlaneXY(0, 0, 0), UComponent=bang.Branch0, VComponent=bang.Branch1, WComponent=0)
pline = PolyLine(Vertices=pt, Closed=False)
panel_2 = Panel(multiplication_2)
