# Grasshopper definition help_htw2ylb_domainBoundary_01.gh (Grasshopper 0.9.76)

panel = Panel("""50 To 70
10 To 80
30 To 99
50 To 75""")
panel_2 = Panel("""99
23
44
77""")
domain = Domain(panel)
num = Number(panel_2)
panel_3 = Panel("""0.92
0.75
0.34
0.66""")
scale = Number(panel_3)
multiplication = Multiplication(A=num, B=scale)
dedomain = DeconstructDomain(Domain=domain)  # -> Start, End
inc = Includes(Value=multiplication, Domain=domain)  # -> Includes, Deviation
entwine = Entwine(Branch00=dedomain.Start, Branch01=dedomain.End, FlattenInputs=True)
bool = Boolean(inc.Includes)
sift = SiftPattern(List=multiplication, SiftPattern=bool)  # -> Output0, Output1
flip = FlipMatrix(Data=entwine)
panel_4 = Panel("比较区间边界和scale后的值,选择较为接近的边界。")
subtraction = Subtraction(A=graft(sift.Output0), B=flip)
abs = Absolute(Value=subtraction)
item = ListItem(List=abs, Index=0, Wrap=True)  # -> Item, Item1
smaller = SmallerThan(FirstNumber=item.Item, SecondNumber=item.Item1)  # -> SmallerThan, OrEqualTo

not = GateNot(A=smaller.SmallerThan)
int = Integer(not)
item_2 = ListItem(List=flip, Index=int, Wrap=True)

panel_5 = Panel("可以看出来boolean值和item的索引值之间有对应关系。")
panel_6 = Panel("这个运算器兼容性不是很好，但最直接。")
combine = CombineData(Input0=flatten(item_2), Input1=sift.Output1)  # -> Result, Index
panel_7 = Panel(combine.Result)
